# Grasshopper definition Grasshopper.gh (Grasshopper 1.0.7)

pt = ConstructPoint(XCoordinate=0, YCoordinate=0, ZCoordinate="10")
pt_2 = ConstructPoint(XCoordinate=0, YCoordinate=0, ZCoordinate="20")
pi = Pi(Factor=Slider(0.69, range=0..1))
polygon = Polygon(Plane=PlaneXY(0, 0, 0), Radius=3, Segments=6, FilletRadius=0)  # -> Polygon, Length
polygon_2 = Polygon(Plane=pt, Radius=3, Segments=6, FilletRadius=0)  # -> Polygon, Length
polygon_3 = Polygon(Plane=pt_2, Radius=3, Segments=6, FilletRadius=0)  # -> Polygon, Length
rotate = Rotate(Geometry=polygon_2.Polygon, Angle=pi, Plane=PlaneXY(0, 0, 0))  # -> Geometry, Transform
loft = Loft(
    Curves=[polygon.Polygon, rotate.Geometry, polygon_3.Polygon],
    Options={Adjust=False, Closed=False, LoftEnds=0, LoftSimp=0, LoftType=0, Rebuild=10, Refit=0.01})
